# Grasshopper definition solar_path_main.gh (Grasshopper 1.0.7)

minutes = Slider(0, range=0..60)
degrees = Slider(40, range=0..89)
division = Division(A=minutes, B=60)
series = Series(Start=-90, Step=15, Count=13)
addition = Addition(A=degrees, B=division)
list = ValueList({"Equinox": 0, "Summer Solstice": 23.45, "Winter Solstice": -23.45}, selected="Equinox")
rad = Radians(Degrees=addition)
rad_2 = Radians(Degrees=series)
rad_3 = Radians(Degrees=list)
c_script = CSharpScript(r=Slider(100, range=0..100), HRA=rad_2, LAT=rad, DEC=rad_3)  # -> out, rs, ds, rsr; inputs r: Double, HRA: Double, LAT: Double, DEC: Double
# ---------- c_script: C# ----------
    double deg = (180.0 / Math.PI);

    double ALT = (Math.Asin((Math.Sin(DEC) * Math.Sin(LAT)) + (Math.Cos(DEC) * Math.Cos(LAT) * Math.Cos(HRA))));

/*
    if (ALT < 0)
    {
      ALT = (ALT * -1);
    } else {
      ALT = ALT * (1);
    }
*/

/*
    if (ALT < 0)
    {
      ALT = (ALT + 90);
    } else {
      ALT = ALT * (1);
    }

  */

    List<double> ALT_list = new List<double>();
    ALT_list.Add(ALT);

    List<double> ALT_list_corrected = new List<double>();

    foreach (double i in ALT_list){
      ALT_list_corrected.Add(i + 0);
    }


    rs = r * Math.Cos(DEC) / (Math.Sin(ALT) + Math.Sin(DEC));
    ds = r * Math.Cos(LAT) / (Math.Sin(LAT) + Math.Sin(DEC));
    rsr = ALT_list_corrected;
# ---------- end c_script ----------
c_script_2 = CSharpScript(x=Slider(90, range=0..100))  # -> out, A; inputs x: Double
# ---------- c_script_2: C# ----------
    if (x < 10){
      A = x;
    }
# ---------- end c_script_2 ----------
deg = Degrees(Radians=c_script.rsr)
arc = Arc(Plane=PlaneXY(0, 0, 0), Radius=c_script.ds, Angle=Domain(0, 3.141592654))  # -> Arc, Length
cos = Cosine(Value=3.14159)
series_2 = Series(Start=0, Step=1, Count=25)
panel = Panel(deg)
pt = ConstructPoint(XCoordinate=flatten(series_2), YCoordinate=flatten(c_script.rs), ZCoordinate=0)
